# Grasshopper definition gh_testSite_decoupling.gh (Grasshopper 1.0.7)
# plug-ins: TableUI

trigger = Trigger(Interval=33, TimerInterval=33, Target=tableui)
tableui = TableUIGH_Adapter(URL="5005", Run=Toggle(True), Expire=1000, RepoStrategy="udp")  # -> Points, Ids, Rotation
panel = Panel(tableui.Rotation)
panel_2 = Panel(tableui.Ids)
panel_3 = Panel(tableui.Points)
